vi "index.gviweb"   [G Web Development Software 22.3.0]
panel controls:
  "input 1": f64 = 6.875
  "Slider": f64 = 75781.25
  "Numeric": f64 = 400000
  "Hyperlink Control": string = "https://www.ni.com/en-us/support/downloads/software-products/download.g-web-development-software.html"
  "Hyperlink Control_2": string = "https://www.ni.com/en-us/shop/electronic-test-instrumentation/application-software-for-electronic-test-and-instrumentation-category/what-is-g-web-development-software.html"
  "Hyperlink Control_4": string = "https://github.com/ni/webvi-examples/tree/main/CallLabVIEWWebService"
  "Hyperlink Control_5": string = "https://github.com/ni/webvi-examples/tree/main/CallSystemLinkDataServices"
  "Hyperlink Control_6": string = "https://github.com/ni/webvi-examples/tree/main/CallJavaScriptFromAWebVI"
  "Hyperlink Control_7": string = "https://github.com/ni/webvi-examples/tree/main/Call3rdPartyWebService"
  "Hyperlink Control_8": string = "https://github.com/ni/webvi-examples/tree/main/MultipleTopLevelWebVIs"
  "Hyperlink Control_9": string = "https://github.com/ni/webvi-examples/tree/main/CustomizeWithCss"
  "Hyperlink Control_11": string = "https://github.com/ni/webvi-examples/tree/main/ConnectWebVIToWebSocketEchoServer"
  "Hyperlink Control_13": string = "https://github.com/ni/webvi-examples/tree/main/EmbedContentIntoWebVI"
  "Hyperlink Control_14": string = "https://github.com/ni/webvi-examples/tree/main/IncorporateUserResources"
  "Hyperlink Control_15": string = "http://www.ni.com/legal/"
  "Hyperlink Control_16": string = "http://www.ni.com/legal/privacy/"
  "notice": string = "https://forums.ni.com/t5/G-Web-Development-Software/G-Web-Development-Software-Compliance-Driven-Lifecycle-Update/td-p/4483530"
panel indicators:
  "Chart": f64
  "Gauge": f64
  "LED": bool
  "URL Image_8": string
  "URL Image": string
  "URL Image_2": string
  "URL Image_3": string
  "URL Image_4": string
  "URL Image_5": string
  "URL Image_7": string
  "URL Image_10": string
  "URL Image_6": string
  "URL Image_11": string
  "URL Image_12": string
  "URL Image_13": string
  "URL Image_14": string
  "URL Image_15": string
diagram:
  while {
    Random Number() -> (number (0 to 1)=w1)
    Multiply(w1, $"input 1") -> w2
    $Chart <- w2
    Wait(time to wait=50)
    stop if FALSE
  }
  while {
    Wait(time to wait=150)
    Random Number() -> (number (0 to 1)=w3)
    Multiply(w3, $Slider) -> w4
    Add(w4, $Slider, $Numeric) -> w5
    $Gauge <- w5
    Is Greater(x=w5, y=500000) -> w6
    $LED <- w6
    stop if FALSE
  }
